# Grasshopper definition 20250622_tools.gh (Grasshopper 1.0.8)
# plug-ins: NGon_RH8

# Export Lines
panel = Panel("C:\D\GitHub\webServer\SBII_Ex2_prestressing\json")
# Export Texts
panel_2 = Panel("C:\D\GitHub\webServer\SBII_Ex2_prestressing\text")
# Export Meshes
mesh = Mesh([<mesh referenced from the Rhino model> x12])
id = Guid([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])
id_2 = Guid([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])
id_3 = Guid(mesh)
number_slider = Slider(0.01, range=0..0.1)
# Mesh Pipes in LowPoly
crv = Curve([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])
python = GhPythonScript(guid=id_3)  # -> out, full_name; inputs guid: Guid
# ---------- python: Python ----------
__author__ = "yang"

import rhinoscriptsyntax as rs
import scriptcontext as sc
import Rhino

sc.doc = Rhino.RhinoDoc.ActiveDoc
obj = sc.doc.Objects.Find(guid)
layer_index = obj.Attributes.LayerIndex
full_name = sc.doc.Layers[layer_index].FullPath
print(full_name)
sc.doc = ghdoc
# ---------- end python ----------
python_2 = GhPythonScript(guids=id, address=panel, write=Button())  # -> out, a; inputs guids: list of Guid, write: Boolean
# ---------- python_2: Python ----------
__author__ = "Wenqian"
__version__ = "2025.03.05"

import rhinoscriptsyntax as rs
import scriptcontext as sc
import Rhino
import json
import os
import System

lines = {}

sc.doc = Rhino.RhinoDoc.ActiveDoc
for guid in guids:
    obj = sc.doc.Objects.Find(guid)
    layer_index = obj.Attributes.LayerIndex
    name = sc.doc.Layers[layer_index].FullPath
    type = rs.ObjectType(guid)
    if type == 4:
        lines.update({name: []})

def write_line(name, lines):
    jsonContent = []
    for i in range(len(lines)):
        jsonContent.append(
        [[lines[i].PointAt(0).X,
        lines[i].PointAt(0).Y,
        lines[i].PointAt(0).Z],
        [lines[i].PointAt(1).X,
        lines[i].PointAt(1).Y,
        lines[i].PointAt(1).Z]]
        )
    jsonContent = {"lines": jsonContent}
    jsonObj = json.dumps(jsonContent, indent=4)
    
    path = os.path.join(address, name +".json")
    
    with open(path, "w") as outFile:
        outFile.write(jsonObj)

fwo = Rhino.FileIO.FileWriteOptions()
options = Rhino.FileIO.FileObjWriteOptions(fwo) 

if write:
    for key, value in lines.items():
        write_line(key, value)
# ---------- end python_2 ----------
python_3 = GhPythonScript(guids=id_2, address=panel_2, write=Button())  # -> out, a; inputs guids: list of Guid, write: Boolean
# ---------- python_3: Python ----------
__author__ = "Wenqian"
__version__ = "2025.03.05"

import rhinoscriptsyntax as rs
import scriptcontext as sc
import Rhino
import json
import os
import System

texts = {}

sc.doc = Rhino.RhinoDoc.ActiveDoc
for guid in guids:
    obj = sc.doc.Objects.Find(guid)
    layer_index = obj.Attributes.LayerIndex
    name = sc.doc.Layers[layer_index].FullPath
    type = rs.ObjectType(guid)
    if type == 512:
        texts.update({name: []})

def write_text(name, texts):
    strings = [text.Text for text in texts]
    locations = [text.Plane for text in texts]
    content = []
    for i in range(len(texts)):
    
        item = {
        "text":strings[i],
        "pt":[locations[i].OriginX, locations[i].OriginY, locations[i].OriginZ]}
        
        content.append(item)
    
    content = {"text3d": content}
    jsonObj = json.dumps(content, indent=4)
    
    fileName = name
    path = os.path.join(address, name+".json")
    
    with open(path, "w") as outFile:
        outFile.write(jsonObj)

fwo = Rhino.FileIO.FileWriteOptions()
options = Rhino.FileIO.FileObjWriteOptions(fwo) 

if write:
    for key, value in texts.items():
        write_text(key, value)
# ---------- end python_3 ----------
meshpipe = MeshPipe(Curve=crv, Radius=Slider(0.005, range=0..0.01), Sides=Slider(4, range=0..10), Tolerance=10, Ending=3)
panel_3 = Panel(python_3.out)
panel_4 = Panel(python_2.out)
c_script = CSharpScript(
    in_run=Button(),
    in_mesh=graft(mesh),
    in_name=graft(python.full_name),
    in_path="C:\D\GitHub\webServer\SBII_Ex2_prestressing\obj\")  # -> out, A; inputs in_run: Boolean, in_mesh: list of Mesh, in_name: String, in_path: String
# ---------- c_script: C# ----------
    if(in_run) {
      path = System.IO.Path.GetDirectoryName(in_path) + "\\" + in_name + ".obj";
      int faceCount = 0;
      using(StreamWriter writer = new StreamWriter(path)) {
        for(int n = 0; n < in_mesh.Count; n++) {
          List<String> vert = new List<String>();
          List<String> face = new List<String>();

          in_mesh[n].Faces.ConvertQuadsToTriangles();
          BoundingBox bbox = in_mesh[n].GetBoundingBox(true);

          for(int i = 0; i < in_mesh[n].Vertices.Count; i++) {
            vert.Add(String.Format("v {0} {1} {2}", -in_mesh[n].Vertices[i].X, in_mesh[n].Vertices[i].Z, in_mesh[n].Vertices[i].Y));
          }

          for(int i = 0; i < in_mesh[n].TextureCoordinates.Count; i++) {
            double tx = in_mesh[n].TextureCoordinates[i].X;
            double ty = in_mesh[n].TextureCoordinates[i].Y;
            vert.Add(String.Format("vt " + tx.ToString("F6") + " " + ty.ToString("F6")));
          }

          for(int i = 0; i < in_mesh[n].Normals.Count; i++) {
            vert.Add(String.Format("vn {0} {1} {2}", -in_mesh[n].Normals[i].X, in_mesh[n].Normals[i].Z, in_mesh[n].Normals[i].Y));
          }

          for(int i = 0; i < in_mesh[n].Faces.Count; i++) {
            MeshFace f = in_mesh[n].Faces.GetFace(i);
            int fa = f.A + 1 + faceCount;
            int fb = f.B + 1 + faceCount;
            int fc = f.C + 1 + faceCount;
            string fas = fa.ToString();
            string fbs = fb.ToString();
            string fcs = fc.ToString();
            face.Add(String.Format("f " + fas + "/" + fas + "/" + fas + " " + fbs + "/" + fbs + "/" + fbs + " " + fcs + "/" + fcs + "/" + fcs));
          }

          for(int i = 0; i < vert.Count; i++) {
            writer.WriteLine(vert[i]);
          }

          writer.WriteLine("");
          writer.WriteLine("g " + in_name + n.ToString());

          for(int i = 0; i < face.Count; i++) {
            writer.WriteLine(face[i]);
          }
          faceCount += in_mesh[n].Vertices.Count;
        }
      }
    }
    A = path;
# ---------- c_script: C# additional code ----------
  String path;
# ---------- end c_script ----------
